# Grasshopper definition algorithm.gh (Grasshopper 0.9.80)

x_y_thickness = Slider(2.5, range=2..2.5)
width = Slider(136, range=130..140)
temple_height = Slider(3.672, range=0..10)
bottom_temple = Slider(46.985, range=-1..50)
bottom_bridge = Slider(21.799, range=1..51)
z_thickness = Slider(4.56, range=4..5)
side_thickness = Slider(5.884, range=5.75..6.25)
bridge_height = Slider(2.771, range=0..7)
top_bridge = Slider(17.003, range=0..50)
top_temple = Slider(-0.618, range=-1..50)
bridge_thickness = Slider(4.5, range=4.5..5.5)
pd = Slider(66, range=65..70)
pt = Point(<point referenced from the Rhino model>)
lens = Geometry(<curve referenced from the Rhino model>)

# ---- group: curve
Z = UnitZ(Factor=Slider(3, range=0..10))
move = Move(Geometry=pt, Motion=Z)  # -> Geometry, Transform
X = UnitX(Factor=Slider(3, range=0..10))
move_2 = Move(Geometry=pt, Motion=X)  # -> Geometry, Transform
division = Division(A=pd, B=2)
X_2 = UnitX(Factor=division)
move_3 = Move(Geometry=pt, Motion=X_2)  # -> Geometry, Transform
division_2 = Division(A=width, B=2)
X_3 = UnitX(Factor=division_2)
move_4 = Move(Geometry=pt, Motion=X_3)  # -> Geometry, Transform
_0_pd = Point(move_3.Geometry)
_0_farright = Point(move_4.Geometry)
_0_0_z = Point(move.Geometry)
number = Number(-1)
X_4 = UnitX(Factor=number)
move_5 = Move(Geometry=_0_farright, Motion=X_4)  # -> Geometry, Transform
Z_2 = UnitZ(Factor=Slider(3, range=0..10))
move_6 = Move(Geometry=_0_pd, Motion=Z_2)  # -> Geometry, Transform
X_5 = UnitX(Factor=Slider(1.7, range=0..3))
X_6 = UnitX(Factor=Slider(2, range=0..3))
move_7 = Move(Geometry=_0_0_z, Motion=X_6)  # -> Geometry, Transform
move_8 = Move(Geometry=move_2.Geometry, Motion=X_5)  # -> Geometry, Transform
_0_pd_z = Point(move_6.Geometry)
_1_0_z = Point(move_7.Geometry)
nurbs = NurbsCurve(
    Vertices=[_0_0_z, _1_0_z, move_2.Geometry, move_8.Geometry, _0_pd_z, move_5.Geometry, _0_farright],
    Degree=3,
    Periodic=False)  # -> Curve, Length, Domain
crv = Curve(flatten(nurbs.Curve))
number_slider = Slider(66, range=0..100)
Y = UnitY(Factor=number_slider)
extr = Extrude(Base=crv, Direction=Y)
multiplication = Multiplication(A=number_slider, B=-0.5)
Y_2 = UnitY(Factor=multiplication)
move_9 = Move(Geometry=extr, Motion=Y_2)  # -> Geometry, Transform
Z_3 = UnitZ(Factor=z_thickness)
extr_2 = Extrude(Base=move_9.Geometry, Direction=Z_3)

# ---- group: inner frame
connect = ConnectCurves(Curves=lens, Continuity=2, Close=True, Bulge=1)
closed_lens = Geometry(connect)
area = Area(Geometry=closed_lens)  # -> Area, Centroid
centerpoint = Point(area.Centroid)
pdecon = Deconstruct(Point=centerpoint)  # -> XComponent, YComponent, ZComponent
number_2 = Number(-1)
number_3 = Number(-1)
multiplication_2 = Multiplication(A=pdecon.YComponent, B=number_2)
multiplication_3 = Multiplication(A=number_3, B=pdecon.XComponent)
X_7 = UnitX(Factor=multiplication_3)
Y_3 = UnitY(Factor=multiplication_2)
move_10 = Move(Geometry=lens, Motion=X_7)  # -> Geometry, Transform
move_11 = Move(Geometry=move_10.Geometry, Motion=Y_3)  # -> Geometry, Transform
inner_lens = Geometry(move_11.Geometry)

# ---- group: center
_0_0_0 = Point(Point(0, 0, 0))
Y_4 = UnitY(Factor=bridge_thickness)
move_12 = Move(Geometry=_0_0_0, Motion=Y_4)  # -> Geometry, Transform
bottom_center_bridge = Point(_0_0_0)
top_center_bridge = Point(move_12.Geometry)
Y_5 = UnitY(Factor=bridge_height)
move_13 = Move(Geometry=bottom_center_bridge, Motion=Y_5)  # -> Geometry, Transform
move_14 = Move(Geometry=top_center_bridge, Motion=Y_5)  # -> Geometry, Transform
ln = Line(StartPoint=move_13.Geometry, EndPoint=move_14.Geometry)
center = Geometry(ln)

# ---- group: side
division_3 = Division(A=width, B=2)
Y_6 = UnitY(Factor=temple_height)
division_4 = Division(A=width, B=2)
_0 = Number(0)
_0_2 = Number(0)
_0_3 = Number(0)
pt_2 = ConstructPoint(XCoordinate=division_3, YCoordinate=side_thickness, ZCoordinate=_0)
pt_3 = ConstructPoint(XCoordinate=division_4, YCoordinate=_0_2, ZCoordinate=_0_3)
move_15 = Move(Geometry=pt_2, Motion=Y_6)  # -> Geometry, Transform
move_16 = Move(Geometry=pt_3, Motion=Y_6)  # -> Geometry, Transform
top_right_point = Point(move_15.Geometry)
bottom_right_point = Point(move_16.Geometry)
ln_2 = Line(StartPoint=move_15.Geometry, EndPoint=move_16.Geometry)
side = Geometry(ln_2)

# ---- group: move PD
_2 = Number(2)
division_5 = Division(A=pd, B=_2)
X_8 = UnitX(Factor=division_5)
move_17 = Move(Geometry=inner_lens, Motion=X_8)  # -> Geometry, Transform

# ---- group: outer frame
offset = Offset(Curve=move_17.Geometry, Distance=x_y_thickness, Plane=PlaneXY(0, 0, 0), Corners=1)
outer_frame = Geometry(flatten(offset))

# ---- group: inner lens curve
curve = Geometry(crv)
inner_lens_2 = Geometry(outer_frame)
number_slider_2 = Slider(65, range=0..100)
Y_7 = UnitY(Factor=number_slider_2)
extr_3 = Extrude(Base=curve, Direction=Y_7)
multiplication_4 = Multiplication(A=number_slider_2, B=-0.5)
Y_8 = UnitY(Factor=multiplication_4)
Z_4 = UnitZ(Factor=Slider(5, range=0..10))
extr_4 = Extrude(Base=inner_lens_2, Direction=Z_4)
move_18 = Move(Geometry=extr_3, Motion=Y_8)  # -> Geometry, Transform
extruded_curve = Geometry(move_18.Geometry)
extruded_lens = Geometry(extr_4)
bbx = BrepBrep(BrepA=extruded_lens, BrepB=extruded_curve)  # -> Curves, Points
inner_lens_curve = Geometry(bbx.Curves)

# ---- group: INCOMPLETE lens groove
groove = Geometry(<curve referenced from the Rhino model>)
pt_4 = Point(<point referenced from the Rhino model>)
inner_lens_curve_2 = Geometry(inner_lens_curve)
crv_cp = CurveClosestPoint(Point=pt_4, Curve=inner_lens_curve_2)  # -> Point, Parameter, Distance
move_19 = Move(Geometry=groove, Motion=crv_cp.Point)  # -> Geometry, Transform
lens_groove_sweep1 = Geometry([move_19.Geometry, inner_lens_curve_2])

# ---- group: bridge
addition = Addition(A=bottom_bridge, B=0.1)
addition_2 = Addition(A=top_bridge, B=0.1)
eval = EvaluateCurve(Curve=outer_frame, Parameter=top_bridge)  # -> Point, Tangent, Angle
eval_2 = EvaluateCurve(Curve=outer_frame, Parameter=addition_2)  # -> Point, Tangent, Angle
eval_3 = EvaluateCurve(Curve=outer_frame, Parameter=addition)  # -> Point, Tangent, Angle
eval_4 = EvaluateCurve(Curve=outer_frame, Parameter=bottom_bridge)  # -> Point, Tangent, Angle
intcrv = Interpolate(Vertices=[eval_3.Point, eval_4.Point, move_13.Geometry], Degree=3, Periodic=False, KnotStyle=1)  # -> Curve, Length, Domain
intcrv_2 = Interpolate(Vertices=[eval.Point, eval_2.Point, move_14.Geometry], Degree=3, Periodic=False, KnotStyle=1)  # -> Curve, Length, Domain
bottom_bridge_2 = Geometry(intcrv.Curve)
top_bridge_2 = Geometry(intcrv_2.Curve)
ln_3 = Line(StartPoint=eval_3.Point, EndPoint=eval.Point)
join = JoinCurves(Curves=[bottom_bridge_2, ln_3, center, top_bridge_2], Preserve=False)  # -> flatten(Curves)

# ---- group: temple
addition_3 = Addition(A=top_temple, B=0.1)
addition_4 = Addition(A=bottom_temple, B=0.1)
eval_5 = EvaluateCurve(Curve=outer_frame, Parameter=addition_3)  # -> Point, Tangent, Angle
eval_6 = EvaluateCurve(Curve=outer_frame, Parameter=top_temple)  # -> Point, Tangent, Angle
eval_7 = EvaluateCurve(Curve=outer_frame, Parameter=addition_4)  # -> Point, Tangent, Angle
eval_8 = EvaluateCurve(Curve=outer_frame, Parameter=bottom_temple)  # -> Point, Tangent, Angle
intcrv_3 = Interpolate(Vertices=[eval_8.Point, eval_7.Point, bottom_right_point], Degree=3, Periodic=False, KnotStyle=1)  # -> Curve, Length, Domain
intcrv_4 = Interpolate(Vertices=[eval_5.Point, eval_6.Point, top_right_point], Degree=3, Periodic=False, KnotStyle=1)  # -> Curve, Length, Domain
top_temple_2 = Geometry(intcrv_4.Curve)
bottom_temple_2 = Geometry(intcrv_3.Curve)

# ----
ln_4 = Line(StartPoint=eval_5.Point, EndPoint=eval_8.Point)

# ---- group: temple (continued)
closed_temple = Geometry([top_temple_2, ln_4, bottom_temple_2, side])
join_2 = JoinCurves(Curves=closed_temple, Preserve=False)  # -> flatten(Curves)

# ---- group: union
half_frame = Geometry([join_2, join, outer_frame])
runion = RegionUnion(Curves=half_frame)
half_outline = Geometry(runion)
inner_frame = Geometry(move_17.Geometry)

# ---- group: Extrude
boundary = BoundarySurfaces(Edges=half_outline)
boundary_2 = BoundarySurfaces(Edges=inner_frame)
sint = SolidIntersection(BrepsA=boundary, BrepsB=boundary_2)
Z_5 = UnitZ(Factor=Slider(18, range=0..100))
extr_5 = Extrude(Base=sint, Direction=Z_5)
solid_right_frame = Geometry(extr_5)

# ---- group: curved frame
right_flat_frame = Geometry(solid_right_frame)
cruve = Geometry(extr_2)
sint_2 = SolidIntersection(BrepsA=cruve, BrepsB=right_flat_frame)
