# Grasshopper definition clamp.gh (Grasshopper 0.9.80)

height = Slider(32, range=0..50)
offset = Slider(5, range=0..10)
temple = Geometry(<curve referenced from the Rhino model>)
Z = UnitZ(Factor=height)
extr = Extrude(Base=temple, Direction=Z)
vec = VectorXYZ(XComponent=offset, YComponent=offset, ZComponent=0)  # -> Vector, Length
extr_2 = Extrude(Base=extr, Direction=vec.Vector)
