# Grasshopper definition temple.gh (Grasshopper 0.9.80)

temple_thickness = Slider(2.507, range=1..3)
hinge_side_length = Slider(3.8, range=0..10)
temple_height = Slider(6, range=0..10)
hinge_y = Slider(12.3, range=0..15)
hinge_z = Slider(1, range=0..2)
hinge_height = Slider(1.112, range=0..5)
temple = Geometry(<curve referenced from the Rhino model>)
curve = Geometry(<curve referenced from the Rhino model>)

# ---- group: temple
end = EndPoints(Curve=temple)  # -> Start, End
pt = Point(end.Start)
Y = UnitY(Factor=temple_height)
move = Move(Geometry=pt, Motion=Y)  # -> Geometry, Transform
ln = Line(StartPoint=pt, EndPoint=move.Geometry)
swp1 = Sweep1(Rail=temple, Sections=ln, Miter=1)
Z = UnitZ(Factor=Slider(22, range=0..100))
extr = Extrude(Base=swp1, Direction=Z)

# ---- group: hinge
_0_0_0 = Point(<point referenced from the Rhino model>)
Y_2 = UnitY(Factor=hinge_side_length)
move_2 = Move(Geometry=_0_0_0, Motion=Y_2)  # -> Geometry, Transform
ln_2 = Line(StartPoint=move_2.Geometry, EndPoint=_0_0_0)
Z_2 = UnitZ(Factor=hinge_side_length)
extr_2 = Extrude(Base=ln_2, Direction=Z_2)
X = UnitX(Factor=hinge_y)
extr_3 = Extrude(Base=extr_2, Direction=X)
Y_3 = UnitY(Factor=hinge_height)
move_3 = Move(Geometry=extr_3, Motion=Y_3)  # -> Geometry, Transform
Z_3 = UnitZ(Factor=hinge_z)
move_4 = Move(Geometry=move_3.Geometry, Motion=Z_3)  # -> Geometry, Transform

# ---- group: curve
Y_4 = UnitY(Factor=Slider(74, range=0..100))
extr_4 = Extrude(Base=curve, Direction=Y_4)
Z_4 = UnitZ(Factor=temple_thickness)
extr_5 = Extrude(Base=extr_4, Direction=Z_4)

# ----
sint = SolidIntersection(BrepsA=extr, BrepsB=extr_5)
right_temple = Geometry([sint, move_4.Geometry])
mirror = Mirror(Geometry=right_temple, Plane=PlaneYZ(0, 0, 0))  # -> Geometry, Transform
temple_2 = Geometry([mirror.Geometry, right_temple])
